# Grasshopper definition debug.gh (Grasshopper 0.9.76)
# plug-ins: Radical

slider_4 = Slider(0.671, range=0..1)
slider_3 = Slider(0.331, range=0..1)
slider_2 = Slider(0.691, range=0..1)
slider_1 = Slider(0.271, range=0..1)
graph = GraphMapper(
    slider_3,
    x0=0,
    x1=1,
    y0=0,
    y1=1,
    container_name="Sinc",
    Equation_X0=0.6186665893,
    Equation_X1=0.7434785366,
    Equation_Y0=0.2637678385,
    Equation_Y1=0.7391304374)
graph_2 = GraphMapper(
    slider_4,
    x0=0,
    x1=1,
    y0=0,
    y1=1,
    container_name="Sinc",
    Equation_X0=0.1579711437,
    Equation_X1=0.7434785366,
    Equation_Y0=0.3072463274,
    Equation_Y1=0.7391304374)
graph_3 = GraphMapper(
    slider_2,
    x0=0,
    x1=1,
    y0=0,
    y1=1,
    container_name="Sinc",
    Equation_X0=0.2681159377,
    Equation_X1=0.7434785366,
    Equation_Y0=0.4202898741,
    Equation_Y1=0.7391304374)
graph_4 = GraphMapper(
    slider_1,
    x0=0,
    x1=1,
    y0=0,
    y1=1,
    container_name="Sinc",
    Equation_X0=0.4273509085,
    Equation_X1=0.7434785366,
    Equation_Y0=0.9422633648,
    Equation_Y1=0.7391304374)
ma = MassAddition(Input=[slider_4, slider_3, slider_2, slider_1])  # -> Result, PartialResults
mm = MassMultiplication(Input=[graph_2, graph, graph_3, graph_4])  # -> Result, PartialResults
number_slider = Slider(1, range=0..1)
number_slider_2 = Slider(1, range=0..1)
sum = Number(ma.Result)
product = Number(mm.Result)
srf = Surface(<surface referenced from the Rhino model>)
dsopt = DSOptimizer(Objective=[product, sum], NumericalVariables=[slider_4, slider_3, slider_2, slider_1])
